# Grasshopper definition Optimization_TrussDiagonals.gh (Grasshopper 0.9.76)
# Copyright: Karamba3D
# plug-ins: Karamba, Python Interpreter

# ---- group: Create Geometry
height = Slider(3, range=0..10)
genes = GenePool(
    Decimals=3,
    Maximum=0.99,
    Minimum=0.01,
    Value=[0.25, 0.355, 0.077, 0.416, 0.672, 0.617, 0.915, 0.651, 0.861, 0.796, 0.479, 0.851, 0.22, 0.277, 0.053, 0.131])
supports = Point([Point(5, 5, 0), Point(30, 15, 0)])
item = ListItem(List=supports, Index=0, Wrap=True)  # -> Item, Item1
panel = Panel("""0
1""")
multiplication = Multiplication(A=height, B=panel)
aligndim = AlignedDimension(Plane=PlaneXY(0, 0, 0), PointA=item.Item, PointB=item.Item1, Offset=-2, Text="{0:0.00}", Size=0.5)
panel_2 = Panel("""0
0""")
panel_3 = Panel("""1
1""")
Z = UnitZ(Factor=multiplication)
merge = Merge(Data1=flatten(panel_2), Data2=flatten(genes), Data3=flatten(panel_3))
partition = PartitionList(List=merge, Size="2")
interp = InterpolateData(Data=supports, Parameter=partition, Interpolation=2)
# 03 - Optimization of Truss Diagonals
# Difficulty: Simple (FREE/PRO version only)
# Here Galapagos is set up to play around with the position of the diagonals of a truss to achieve minimum deflection.
# Instead of using line geometry to generate the beams, here indices of the points are used to create the beams and supports.
addition = Addition(A=Z, B=interp)

# ---- group: Optimise Diagonal Positions with Galapagos
galapagos = Galapagos(fitness=displace, gene=genes)

# ----
capture = BooleanToggle(False)

# ---- group: Define Supports
panel_4 = Panel("""0
Int(x-2)""")
lng = ListLength(List=flatten(partition))
eval = Evaluate(F=panel_4, x=lng)
dispatch = Dispatch(List=supports, DispatchPattern=[True, False])  # -> ListA, ListB
vec2pt = Vector2Pt(PointA=dispatch.ListA, PointB=dispatch.ListB, Unitize=False)  # -> Vector, Length
panel_5 = Panel(eval)
dispatch_2 = Dispatch(List=panel_5, DispatchPattern=[True, False])  # -> ListA, ListB
align = AlignPlane(Plane=dispatch.ListA, Direction=vec2pt.Vector)  # -> Plane, Angle
supp = SupportKaramba(PosInd=dispatch_2.ListA, Plane=align.Plane, menu=[buttons(off, on, on, on, off, off)])
supp_2 = SupportKaramba(PosInd=dispatch_2.ListB, Plane=align.Plane, menu=[buttons(on, on, on, on, off, off)])

# ---- group: Define Elements
cluster = Cluster(L=flatten(partition))  # -> S, A
cull_i = CullIndex(List=reverse(cluster.A), Indices=0, Wrap=True)  # -> reverse(List)
cull_i_2 = CullIndex(List=cluster.A, Indices=0, Wrap=True)
dispatch_3 = Dispatch(List=cluster.S, DispatchPattern=[True, False])  # -> ListA, ListB
ids = Panel("x")
ids_2 = Panel("""A
B""")
indtobeam = IndexToBeamKaramba3D(IndexA=dispatch_3.ListA, IndexB=dispatch_3.ListB, Identifier=ids)
indtobeam_2 = IndexToBeamKaramba3D(IndexA=cull_i_2, IndexB=cull_i, Identifier=graft(ids_2))
pt = Point(flatten(addition))

# ---- group: Define Cross Section
number_slider = Slider(20.2, range=5..35)
cross_section = CrossSectionKaramba3D(
    FamilyNameOfCrossSection="DefaultCroSec",
    Material=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,
    Diameter_cm=number_slider,
    WallThickness_cm=expr("x/2", number_slider),
    mode="Circular Hollow")

# ---- group: Define Loads
Z_2 = UnitZ(Factor="-5")
ids_3 = Panel("B")
loads = LoadsKaramba3D(Vector=Z_2, BeamIdentifiers=ids_3, LCase=0, mode="Uniform Line", menu=[buttons(off, on, off)])

# ---- group: Assemble Model
assemble = AssembleModelKaramba(
    Point=pt,
    Elem=flatten([indtobeam, indtobeam_2]),
    Support=flatten([supp, supp_2]),
    Load=flatten(loads),
    CrossSection=flatten(cross_section),
    LDist=0.005)  # -> Model, Info, Mass, CenterOfGravity

# ---- group: Analyze Model
analyze = AnalyzeKaramba3D(Model=assemble.Model)  # -> CalculatedModel, MaximumDisplacement_cm, ResultingForceOfGravity_kN, ElasticEnergy_kNm

# ----
displace = Number(analyze.MaximumDisplacement_cm)
panel_6 = Panel(displace)

# ---- group: scraper
python = PythonScript(Toggle=capture, goalValue=displace, width="1920", height="1080", data=merge)  # -> out, a; inputs width: Int32, height: Int32, data: list
# ---------- python: Python ----------
"""
Capture the Rhino viewports to an image file. Places the images in a folder with 
the same name as the GH file and in the same directory as the GH file. It 
captures the data used during the optimization process in a CSV file named and 
saved in the same way as described for the images.

    Inputs:
        Toggle:      Activate the component using a boolean toggle
        goalValue:   receives goal value
        width:       width of the screen to be captured
        height:      height of the screen to be captured
        data:        data list    
"""

import scriptcontext as sc
import Rhino as rc
import os
import System

def checkOrMakeFolder():   

    """ Check/makes a "Captures" folder in the GH def folder """

    if ghdoc.Path:
        folder = os.path.dirname(ghdoc.Path)               
        ghDef = ghenv.LocalScope.ghdoc.Name.strip("*") 
        captureFolder = folder + "\\" + str(ghDef)         
        if not os.path.isdir(captureFolder):              
            os.makedirs(captureFolder)                     
        return captureFolder                               


def makeFileName(): 

    """ Make a string with the gh def name + current hourMinuteSecond """

    fileName = str(goalValue)                             
    return fileName                                        

def captureActiveViewToFile(width,height,path): 

    """
    Captures the active view to an image file at the path. Path looks like this:
    "C:\\Users\\adel\\Desktop\\Captures\\goalValue.png"
    """

    sc.doc = rc.RhinoDoc.ActiveDoc                         
    activeView = sc.doc.Views.ActiveView                   
    imageDim = System.Drawing.Size(width,height)           
    try:                                                   
        imageCap = rc.Display.RhinoView.CaptureToBitmap(activeView,imageDim)
        System.Drawing.Bitmap.Save(imageCap,path)
        rc.RhinoApp.WriteLine(path)
        return path                                        
    except:                                                
        raise Exception(" Capture failed, check the path")


if Toggle:                                                      
    capFolder = checkOrMakeFolder()                             
    fileText = os.path.join(capFolder + ".csv")
    with open(fileText, 'a') as file_object:
        fileName = makeFileName()                               
        count = 0
        try:                                                    
            path = os.path.join(capFolder,fileName + ".png")    
            Path = captureActiveViewToFile(width,height,path)   
        except:                                                
            raise Exception("Capture failed, save the GH definition")
        converte = ', '.join(map(str, data))
        concatenatedData = converte + ", " + fileName + "\n"
        file_object.write(concatenatedData)
# ---------- end python ----------

# ---- group: View Results
modelview = ModelViewKaramba3D(Model=analyze.CalculatedModel, LoadCaseFactorsForLinearSuperposition=1, IndexOfVisibleLoadcase=-1)  # -> Model, DeformedMesh, DeformedAxes, DeformedModel
beamview = BeamViewKaramba(Model=modelview.Model)  # -> Model, MeshOfRendering, DeformedBeamAxes, LegendColors, LegendTags

# ==== cluster Cluster
L = ClusterInput()
lng = ListLength(List=L)
series = Series(Start=0, Step=1, Count=lng)
partition = PartitionList(List=L, Size="2")
partition_2 = PartitionList(List=series, Size="2")
flip = FlipMatrix(Data=partition)
flip_2 = FlipMatrix(Data=partition_2)
sort = SortList(Keys=flip, ValuesA=flip_2)  # -> Keys, simplify(ValuesA)
S = ClusterOutput(series)
A = ClusterOutput(sort.ValuesA)
